# Grasshopper definition BIM Generation Test.gh (Grasshopper 1.0.7)
# plug-ins: Rhino.Inside for Autodesk Revit

number_slider = Slider(4500, range=0..10000)
number_slider_2 = Slider(41198, range=0..100000)
number_slider_3 = Slider(19, range=0..100)
component_family = ComponentFamiliesPicker({"Area Tags : M_Area Tag": "199adc15-76fe-4398-841d-8630a979642b-23afd781-9f1e-4b22-8309-8c5afbe244cf-00024291", "Balusters : M_Baluster - Round": "199adc15-76fe-4398-841d-8630a979642b-23afd781-9f1e-4b22-8309-8c5afbe244cf-000264a9", "Balusters : M_Baluster - Square": "199adc15-76fe-4398-841d-8630a979642b-23afd781-9f1e-4b22-8309-8c5afbe244cf-00026680", "Balusters : M_Baluster - Steel Flat Upright": "199adc15-76fe-4398-841d-8630a979642b-23afd781-9f1e-4b22-8309-8c5afbe244cf-00028365", "Balusters : M_Panel - Glazed": "199adc15-76fe-4398-841d-8630a979642b-23afd781-9f1e-4b22-8309-8c5afbe244cf-00028650", "Callout Heads : M_Callout Head": "199adc15-76fe-4398-841d-8630a979642b-23afd781-9f1e-4b22-8309-8c5afbe244cf-0002435e"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}, selected="Area Tags : M_Area Tag")
unit_z = UnitZ(Factor=number_slider)
rectangle = Rectangle(Plane=PlaneXY(0, 0, 0), XSize=number_slider_2, YSize=number_slider_2, Radius=0)  # -> Rectangle, Length
divide_surface = DivideSurface(Surface=rectangle.Rectangle, UCount=number_slider_3, VCount=number_slider_3)  # -> flatten(Points), Normals, Parameters
add_level = AddLevel(Elevation=Slider(0, range=0..1))
list_length = ListLength(List=divide_surface.Points)
elementtype_picker = ElementTypePicker(
    component_family,
    {"M_Area Tag : M_Area Tag": "199adc15-76fe-4398-841d-8630a979642b-0db45dae-9313-11d5-93d5-0000863f27ad-00002251"}, selected="M_Area Tag : M_Area Tag")
random = Random(Range=list_length, Number=Slider(100, range=0..10000), Seed=Slider(203, range=0..10000))
add_floor = AddFloor(Boundary=rectangle.Rectangle, Level=add_level)
list_item = ListItem(List=divide_surface.Points, Index=random, Wrap=True)  # -> graft(Item)
move = Move(Geometry=list_item, Motion=unit_z)  # -> Geometry, Transform
item_index = ItemIndex(List=flatten(list_item), Item=flatten(list_item))  # -> simplify(graft(Index))
line = Line(StartPoint=list_item, EndPoint=move.Geometry)
cull_index = CullIndex(List=flatten(list_item), Indices=item_index, Wrap=True)
closest_point = ClosestPoint(Point=list_item, Cloud=cull_index)  # -> ClosestPoint, CPIndex, Distance
gradient = Gradient(LowerLimit=0, UpperLimit=1, Parameter=Slider(0.5, range=0..1), stops=[0.15: RGB(255, 130, 160), 0.85: RGB(220, 0, 40)])
line_2 = Line(StartPoint=list_item, EndPoint=closest_point.ClosestPoint)
cloud_display = CloudDisplay(Points=divide_surface.Points, Colours=gradient, Size=Slider(250, range=0..1000), SpriteType=0)
add_column = AddColumn(Curve=line, Type=elementtype_picker, Level=add_level)
add_wall_curve = AddWallCurve(
    Curve=line_2,
    Level=add_level,
    Height=number_slider,
    LocationLine=0,
    Flipped=True,
    AllowJoins=Toggle(True),
    StructuralUsage=2)
